# Dynamo graph SP_Estudo_Plano.dyn (Dynamo 2.3.0.5885)
# packages: Sistemas_Projetivos 1.0.0

watch = Watch()  # unwired: arg0
rota_plano_de_projeção = DoubleSlider(90, range=0..90 step 10)  # "Rota Plano de Projeção Horizontal"; graph input
tamanho_construção = DoubleSlider(3, range=1..25 step 1)  # graph input
deslocar = DoubleSlider(126, range=1..150 step 1)  # graph input
SP_Sistema_Diedrico = Custom[SP_Sistema_Diedrico](Escala=tamanho_construção, Deslocar=deslocar)  # package Sistemas_Projetivos; Cria os planos de projeção
abscissa = DoubleSlider(3.1, range=0..5 step 0.1)  # graph input
afastamento = DoubleSlider(4.3, range=0..5 step 0.1)  # graph input
cota = DoubleSlider(3.5, range=0..5 step 0.1)  # graph input
SP_Locar_Ponto = Custom[SP_Locar_Ponto](Diedro=SP_Sistema_Diedrico, abscissa=abscissa, Afastamento=afastamento, Cota=cota)  # package Sistemas_Projetivos; Localiza um ponto em Sistema Diedrico
abscissa_2 = DoubleSlider(4.2, range=0..5 step 0.1)  # graph input
afastamento_2 = DoubleSlider(4.3, range=0..5 step 0.1)  # graph input
cota_2 = DoubleSlider(1, range=0..5 step 0.1)  # graph input
SP_Locar_Ponto_2 = Custom[SP_Locar_Ponto](Diedro=SP_Sistema_Diedrico, abscissa=abscissa_2, Afastamento=afastamento_2, Cota=cota_2)
abscissa_3 = DoubleSlider(5, range=0..5 step 0.1)  # graph input
afastamento_3 = DoubleSlider(1.3, range=0..5 step 0.1)  # graph input
cota_3 = DoubleSlider(4.7, range=0..5 step 0.1)  # graph input
SP_Locar_Ponto_3 = Custom[SP_Locar_Ponto](Diedro=SP_Sistema_Diedrico, abscissa=abscissa_3, Afastamento=afastamento_3, Cota=cota_3)
SP_Locar_Plano = Custom[SP_Locar_Plano](P1=SP_Locar_Ponto.Ponto, P2=SP_Locar_Ponto_2.Ponto, P3=SP_Locar_Ponto_3.Ponto, Diedro=SP_Locar_Ponto_3.Diedro)  # package Sistemas_Projetivos; Posiciona um plano a partir de 3 pontos
SP_Rotaciona_PPH_Plano = Custom[SP_Rotaciona_PPH_Plano](Angulo=rota_plano_de_projeção, Plano=SP_Locar_Plano.Plano, Diedro=SP_Locar_Plano.Diedro)  # package Sistemas_Projetivos; Rotaciona o PPH do traçado
watch_2 = Watch()  # unwired: arg0
qretas = DoubleSlider(2, range=1..25 step 1)  # graph input
homologia_01 = Custom[Homologia_01](Angulo=rota_plano_de_projeção, Plano=SP_Locar_Plano.Plano, Quantidade_de_Retas=qretas, Diedro=SP_Locar_Plano.Diedro)  # Se uma reta pertence a um plano os traços da reta são pontos que pertencem aos traços do plano
