# Dynamo graph SP_Estudo_Ponto.dyn (Dynamo 2.3.0.5885)
# packages: Sistemas_Projetivos 1.0.0

SP_Sistema_Diedrico = Custom[SP_Sistema_Diedrico]()  # package Sistemas_Projetivos; Cria os planos de projeção
abscissa = DoubleSlider(1.9, range=0..5 step 0.1)
afastamento = DoubleSlider(3.4, range=-5..5 step 0.1)
cota = DoubleSlider(3, range=-5..5 step 0.1)
SP_Locar_Ponto = Custom[SP_Locar_Ponto](Diedro=SP_Sistema_Diedrico, abscissa=abscissa, Afastamento=afastamento, Cota=cota)  # package Sistemas_Projetivos; Localiza um ponto em Sistema Diedrico
rota_plano_de_projeção = DoubleSlider(90, range=0..90 step 10)  # "Rota Plano de Projeção Horizontal"
SP_Rotaciona_PPH_Ponto = Custom[SP_Rotaciona_PPH_Ponto](Diedro=SP_Locar_Ponto.Diedro, Ponto=SP_Locar_Ponto.Ponto, Angulo=rota_plano_de_projeção)  # Rotaciona o PPH do traçado
