# Dynamo graph SP_Estudo_Reta.dyn (Dynamo 2.3.0.5885)
# packages: Sistemas_Projetivos 1.0.0

SP_Sistema_Diedrico = Custom[SP_Sistema_Diedrico]()  # package Sistemas_Projetivos; Cria os planos de projeção
abscissa = DoubleSlider(3, range=0..5 step 0.1)
afastamento = DoubleSlider(2.5, range=0..5 step 0.1)
cota = DoubleSlider(1.1, range=0..5 step 0.1)
SP_Locar_Ponto = Custom[SP_Locar_Ponto](Diedro=SP_Sistema_Diedrico, abscissa=abscissa, Afastamento=afastamento, Cota=cota)  # package Sistemas_Projetivos; Localiza um ponto em Sistema Diedrico
abscissa_2 = DoubleSlider(1.6, range=0..5 step 0.1)
afastamento_2 = DoubleSlider(3.1, range=0..5 step 0.1)
cota_2 = DoubleSlider(0.5, range=0..5 step 0.1)
SP_Locar_Ponto_2 = Custom[SP_Locar_Ponto](Diedro=SP_Sistema_Diedrico, abscissa=abscissa_2, Afastamento=afastamento_2, Cota=cota_2)
SP_Locar_Reta = Custom[SP_Locar_Reta](Ponto_1=SP_Locar_Ponto.Ponto, Ponto_2=SP_Locar_Ponto_2.Ponto, Diedro=SP_Locar_Ponto_2.Diedro)  # package Sistemas_Projetivos; Projeta reta
rota_plano_de_projeção = DoubleSlider(90, range=0..90 step 10)  # "Rota Plano de Projeção Horizontal"
SP_Rotaciona_PPH_Reta = Custom[SP_Rotaciona_PPH_Reta](Diedro=SP_Locar_Reta.Diedro, Reta=SP_Locar_Reta.Reta, Angulo=rota_plano_de_projeção)  # Rotaciona o PPH do traçado
