# Dynamo custom node SP_Locar_Plano.dyf (Dynamo 2.3.0.5885)
# category: Sistemas_Projetivos
# Posiciona um plano a partir de 3 pontos

P1 = Input(P1: var[]..[])  # Se refere a um ponto utilizando as função SP_Locar_Ponto
P2 = Input(P2: var[]..[])  # Se refere a um ponto utilizando as função SP_Locar_Ponto
P3 = Input(P3: var[]..[])  # Se refere a um ponto utilizando as função SP_Locar_Ponto
Diedro = Input(Diedro: var[]..[])  # Lista com os 4 semiplanos de projeção
code_block = CodeBlock(p1=P1, p2=P2, p3=P3, Diedro=Diedro)
# ---------- code_block.designscript (50 lines) ----------
p1;
p2;
p3;
Diedro;

LTE = Diedro["LTerra"   ];
PPR = Diedro["Diedro"   ];
pt1 = p1["Ponto"];
pt2 = p2["Ponto"];
pt3 = p3["Ponto"];
pr1 = p1["PontosProj"];
pr2 = p2["PontosProj"];
pr3 = p3["PontosProj"];
ra1 = p1["RaiosProj"];
ra2 = p2["RaiosProj"];
ra3 = p3["RaiosProj"];
ch1 = p1["Chamadas"];
ch2 = p2["Chamadas"];
ch3 = p3["Chamadas"];

NormaZ  = Surface.NormalAtPoint(Super, pt1).Z;
NormaY  = Surface.NormalAtPoint(Super, pt1).Y;
Vz      = Vector.ZAxis();
Vy      = Vector.YAxis();

L3P     = [pt1 , pt2 , pt3];
LUP     = List.UniqueItems ( L3P );
Qpo     = List.Count(LUP);
FigPla  = Qpo == 3? Plane.ByThreePoints       (LUP[0]   , LUP[1]   , LUP[2]  ):
          Qpo == 2? Line.ByStartPointEndPoint (LUP[0]   , LUP[1]             ):
                    Point.ByCoordinates       (LUP[0].X , LUP[0].Y , LUP[0].Z);

Polig  = PolyCurve.ByPoints ( L3P       , true               );
Super  = Surface.ByPatch    ( Polig                          );
proHV  = PolyCurve.Project  ( Polig     ,  PPR<1> , [Vz, Vy] );
Tracos = Plane.Intersect    ( FigPla<1> , [PPR[1] , PPR[2]]  );

ke     = ["Pontos"       , "Raios"        ,  "Chamadas"     ,
          "PtProjetado"  , "Contorno"     ,  "Superficie"   ,
          "Projeções"    , "Figura"       ,  "Traços"       ];
va     = [ L3P            , [ra1, ra2, ra3], [ch1, ch2, ch3],
           [pr1, pr2, pr3], Polig          , Super          ,
           proHV          , FigPla         , Tracos         ];

Dic     = Dictionary.ByKeysValues(ke, va);
Diedro;
[LTE, PPR, pt1, pt2, pt3,
           pr1, pr2, pr3,
           ra1, ra2, ra3,
           ch1, ch2, ch3, FigPla, Polig, Super, proHV, Tracos ];
# ----------------------------------------
Plano = Output(code_block.out32)
Diedro_2 = Output(code_block.out33)  # "Diedro"
ElementosGeometricos = Output(code_block.out34)
