# Dynamo custom node SP_Locar_Ponto.dyf (Dynamo 2.3.0.5885)
# category: Sistemas_Projetivos
# Localiza um ponto em Sistema Diedrico

Diedro = Input(Diedro: var[]..[])  # Lista com os 4 semiplanos de projeção
abscissa = Input(abscissa: var[]..[])
Afastamento = Input(Afastamento: var[]..[])
Cota = Input(Cota: var[]..[])
code_block = CodeBlock(Diedro=Diedro, i1=abscissa, j1=Afastamento, k1=Cota)
# ---------- code_block.designscript (33 lines) ----------
Diedro;
ESC       = Diedro["Escala"   ];
DES       = Diedro["Deslocar" ];
LTE       = Diedro["LTerra"   ];
PPR       = Diedro["Diedro"   ];
Cuboides  = Diedro["Cuboides" ];
Bisetores = Diedro["Bisetores"];

d         =  ESC;
plH       =  PPR[0];
plV       =  PPR[1];

x1        =  ( i1*d) + DES;
y1        =   -j1*d;
z1        =    k1*d;

dirH      = z1 > 0 ? Vector.ZAxis ().Reverse() : Vector.ZAxis();
dirV      = y1 > 0 ? Vector.YAxis ().Reverse() : Vector.YAxis();

ponto     = Point.ByCoordinates        ( x1 , y1  , z1            );
ponsol    = Sphere.ByCenterPointRadius ( ponto    , 0.45          );
projh     = Point.Project              ( ponto<1> , PPR  , dirH );
projv     = Point.Project              ( ponto<1> , PPR  , dirV );
RAI       = Line.ByStartPointEndPoint  ( ponto<1> , [projh ,projv]);
CHA1      = Geometry.Translate         ( RAI[1]   , dirH ,  z1<0?-z1:z1);
CHA2      = Geometry.Translate         ( RAI[0]   , dirV ,  y1<0?-y1:y1);

Kep    = [ "Ponto" , "Esfera" , "PontosProj"  , "RaiosProj" , "Chamadas" ];
Vap    = [  ponto  ,  ponsol  , [projh,projv] ,  RAI        , [CHA1,CHA2]];

Ponto  = Dictionary.ByKeysValues(Kep, Vap);
Diedro;
[LTE, PPR, ponto, ponsol, projh, projv, RAI, CHA1, CHA2];
# ----------------------------------------
Ponto = Output(code_block.out24)
Diedro_2 = Output(code_block.out25)  # "Diedro"
Elementos_Geométricos = Output(code_block.out26)
