# Dynamo custom node SP_Locar_Reta.dyf (Dynamo 2.3.0.5885)
# category: Sistemas_Projetivos
# Projeta reta

Ponto_1 = Input(Ponto_1: var[]..[])  # Se refere a um ponto criado pela função SP_Locar_Ponto
Ponto_2 = Input(Ponto_2: var[]..[])  # Se refere a um ponto criado pela função SP_Locar_Ponto
code_block = CodeBlock(Ponto1=Ponto_1, Ponto2=Ponto_2)
# ---------- code_block.designscript (28 lines) ----------
Lterra  = Ponto1["LTerra"    ];
Planos  = Ponto1["Planos"    ];
//---------------------------------------------------------
p1      = Ponto1["Ponto"     ];
proj1   = Ponto1["PontosProj"];
cham1   = Ponto1["Chamadas"  ];
raio1   = Ponto1["RaiosProj" ];
//---------------------------------------------------------
p2      = Ponto2["Ponto"     ];
proj2   = Ponto2["PontosProj"];
cham2   = Ponto2["Chamadas"  ];
raio2   = Ponto2["RaiosProj" ];
//---------------------------------------------------------
R1      = Line.ByStartPointEndPoint  ( p1    , p2         );
rj1     = Line.ByStartPointEndPoint  ( proj1 , proj2      );
SolPts  = Sphere.ByCenterPointRadius ( [p1   , p2] , 0.35 );
SolRet  = Cylinder.ByPointsRadius    (  p1   , p2  , 0.35 );
//---------------------------------------------------------
Epura   = [proj1[0], proj2[0], cham1[1], cham2[1], rj1[0]];

Ke      = ["Reta"  , "Projeções", "Solidos"     ,
           "Epura" , "LTerra"   , "Pl_Projeção" ,
           "Ponto1", "Ponto2"];
Va      = [  R1    ,   rj1      , [SolPts, SolRet],
           Epura   ,  Lterra    ,  Planos         ,
           Ponto1  ,  Ponto2 ];

Traçado = Dictionary.ByKeysValues(Ke, Va);
# ----------------------------------------
Traçado = Output(code_block.Traçado)
