# Dynamo graph SP_Rebatimento.dyn (Dynamo 2.3.0.5885)
# packages: Sistemas_Projetivos 1.0.0

rota_plano_de_projeção = DoubleSlider(1, range=0..1 step 0.05)  # "Rota Plano de Projeção Horizontal"; graph input
tamanho_construção = DoubleSlider(8, range=1..25 step 1)  # graph input
deslocar = DoubleSlider(94, range=1..150 step 1)  # graph input
SP_Sistema_Diedrico = Custom[SP_Sistema_Diedrico](Escala=tamanho_construção, Deslocar=deslocar)  # package Sistemas_Projetivos; Cria os planos de projeção
abscissa = DoubleSlider(2.6, range=0..5 step 0.1)  # graph input
afastamento = DoubleSlider(1.6, range=0..5 step 0.1)  # graph input
cota = DoubleSlider(3.5, range=0..5 step 0.1)  # graph input
SP_Locar_Ponto = Custom[SP_Locar_Ponto](Diedro=SP_Sistema_Diedrico, abscissa=abscissa, Afastamento=afastamento, Cota=cota)  # package Sistemas_Projetivos; Localiza um ponto em Sistema Diedrico
abscissa_2 = DoubleSlider(1.8, range=0..5 step 0.1)  # graph input
afastamento_2 = DoubleSlider(4.3, range=0..5 step 0.1)  # graph input
cota_2 = DoubleSlider(1, range=0..5 step 0.1)  # graph input
SP_Locar_Ponto_2 = Custom[SP_Locar_Ponto](Diedro=SP_Sistema_Diedrico, abscissa=abscissa_2, Afastamento=afastamento_2, Cota=cota_2)
abscissa_3 = DoubleSlider(5, range=0..5 step 0.1)  # graph input
afastamento_3 = DoubleSlider(1.3, range=0..5 step 0.1)  # graph input
cota_3 = DoubleSlider(0.4, range=0..5 step 0.1)  # graph input
SP_Locar_Ponto_3 = Custom[SP_Locar_Ponto](Diedro=SP_Sistema_Diedrico, abscissa=abscissa_3, Afastamento=afastamento_3, Cota=cota_3)
SP_Locar_Plano = Custom[SP_Locar_Plano](P1=SP_Locar_Ponto.Ponto, P2=SP_Locar_Ponto_2.Ponto, P3=SP_Locar_Ponto_3.Ponto, Diedro=SP_Locar_Ponto_3.Diedro)  # package Sistemas_Projetivos; Posiciona um plano a partir de 3 pontos
qretas = DoubleSlider(1, range=1..25 step 1)  # graph input
SP_Rebatimento_01 = Custom[SP_Rebatimento_01]()  # Faz rebatimento de um plano combinando Homologia Afim e Método dos triângulos; unwired: Angulo, Quantidade_de_Retas, Plano, Diedro
