# Dynamo custom node SP_Rebatimento_01.dyf (Dynamo 2.3.0.5885)
# category: Sistemas_Projetivos
# Faz rebatimento de um plano combinando Homologia Afim e Método dos triângulos

Angulo = Input(Angulo: var[]..[])
Quantidade_de_Retas = Input(Quantidade_de_Retas: var[]..[])
Plano = Input(Plano: var[]..[])
Diedro = Input(Diedro: var[]..[])
rebatimento_de_um_plano = CodeBlock(parang=Angulo, Qr=Quantidade_de_Retas, Plano=Plano, Diedro=Diedro)
# ---------- rebatimento_de_um_plano.designscript (72 lines) ----------
parang;
Qr;
Plano;
Diedro;
LTE    = Diedro["LTerra"    ];
PPR    = Diedro["Diedro"    ];
PTS    = Plano ["Pontos"    ];
TRA    = Plano ["Traços"    ];
FIG    = Plano ["Figura"    ];
SUP    = Plano ["Superficie"];
RAI    = Plano ["Raios"     ];
CON    = Plano ["Contorno"  ];
PTR    = List.Flatten ( Plano["PtProjetado"] , 3);
PRO    = List.Flatten ( Plano["Projeções"  ] , 3);
CHA    = List.Flatten ( Plano["Chamadas"   ] , 3);
TRAH   = List.Flatten ( TRA , 1)[0];
TRAV   = List.Flatten ( TRA , 1)[1];

BaseZ  = Vector.ZAxis();
dirh   = BaseZ.Reverse();
dirv   = Vector.YAxis ( );
Norm   = FIG.Normal;

ProjH   = [PTR[0], PTR[2], PTR[4]];
//----------------------------------------------------------------
//Inclinação do Plano
angulo  = Vector.AngleWithVector    ( BaseZ , Norm ) * parang;
//----------------------------------------------------------------
Lifig   = Surface.PerimeterCurves   ( SUP         );
Ptfig   = Line.PointAtParameter     ( Lifig<1> , 0..1..(1/Qr));
LiPla   = Line.ByStartPointEndPoint ( Ptfig    , List.ShiftIndices (Ptfig , 1));
//----------------------------------------------------------------
// Cateto do triangulo de rebatimento (igual à Cota do ponto)
Cateto  = Line.ByStartPointDirectionLength   ( ProjH , eixo  ,  PTS.Z);
PtCat1  = Cateto.EndPoint;
//----------------------------------------------------------------
//Direção da Homologia Afim (Ortogonal ao traço Horizontal)
//----------------------------------------------------------------
dirHom  = Line.ByStartPointDirectionLength   ( ProjH , eixoN , -PTS.Z*2);
Centros = List.Flatten( Line.Intersect (TRAH<1> , dirHom), 1);
Hipoten = Line.ByStartPointEndPoint    ( Centros, PtCat1);
Arcos   = Arc.ByCenterPointStartPointSweepAngle ( Centros, PtCat1 , -angulo, BaseZ);

HoPOH  = [ Line.Intersect ( TRAH<1> , Curve.ExtendStart ( LiPla , 1000)) ,
           Line.Intersect ( TRAH<1> , Curve.ExtendEnd   ( LiPla , 1000)) ];
HoPOV  = [ Line.Intersect ( TRAV<1> , Curve.ExtendStart ( LiPla , 1000)) ,
           Line.Intersect ( TRAV<1> , Curve.ExtendEnd   ( LiPla , 1000)) ];

HoLIH  = [ Line.ByStartPointEndPoint ( HoPOH[0] , LiPla.StartPoint ),
           Line.ByStartPointEndPoint ( HoPOH[1] , LiPla.EndPoint   ) ];
HoLIV  = [ Line.ByStartPointEndPoint ( HoPOV[0] , LiPla.StartPoint ),
           Line.ByStartPointEndPoint ( HoPOV[1] , LiPla.EndPoint   ) ];

ProHP   = Point.Project ( HoPOH , PPR<1> , dirh );
ProHL   = Line.Project  ( HoLIH , PPR<1> , dirh );
ProHLi  = Line.Project  ( LiPla , PPR<1> , dirh );
ProVP   = Point.Project ( HoPOV , PPR<1> , dirv );
ProVL   = Line.Project  ( HoLIV , PPR<1> , dirv );
//----------------------------------------------------------------
//O traço horizontal do Plano é o Eixo de Homologia do rebatimento
//----------------------------------------------------------------
eixo      = TRAH.Direction;
eixoN     = Vector.Rotate(eixo, BaseZ, 90);
orig      = Line.PointAtParameter ( TRAH      , 0.0 );
Pthomo3D  = List.Flatten          ( [ HoPOH , Ptfig             ] , 10  );
Lihomo3D  = List.Flatten          ( [ Lifig , LiPla, HoLIH , SUP] , 10  );

Pthomo2D  = Pthomo3D!=null?Geometry.Rotate( Pthomo3D , orig, eixo, angulo):null;
Lihomo2D  = Lihomo3D!=null?Geometry.Rotate( Lihomo3D , orig, eixo, angulo):null;

[ProHLi, HoPOH, HoPOV, HoLIH, HoLIV, Ptfig, LiPla, Pthomo3D, Lihomo3D, Pthomo2D,
Lihomo2D, Cateto, dirHom, Centros, Arcos, Hipoten];
# ----------------------------------------
Resultado = Output(rebatimento_de_um_plano.out48)
