# Dynamo custom node SP_Rotaciona_PPH_Plano.dyf "SP_Rotacionar_Plano" (Dynamo 2.3.0.5885)
# category: Sistemas_Projetivos
# Rotaciona o plano de projeção horizontal para formar a Epura 2D

Angulo = Input(Angulo: var[]..[])
Plano = Input(Plano: var[]..[])  # Se refere ao plano criado com a função SP_Locar_Plano
code_block = CodeBlock(angulo=Angulo, Plano=Plano)
# ---------- code_block.designscript (34 lines) ----------
angulo;
Plano;
LTE = Plano["LTerra"];
PTS = Plano["Pontos"];
ESF = Plano["Esferas"];
TRA = Plano["Traços"];
FIG = Plano["Figura"];
PRO = Plano["Projeções"];
SUP = Plano["Superficie"];
RAI = Plano["Raios"];
CON = Plano["Contorno"];
INF = Plano["PlanoInfinito"];

Tracos   = Plano["Traços"];
Diedros  = Plano["Diedro"];
PontoPro = Plano["PtProjetado"];
Chamadas = Plano["Chamadas"];
Projetad = Plano["Projeções"];
//--------------------------------------------
//Constantes----------------------------------
//--------------------------------------------
orig   = Point.ByCoordinates ( 0 , 0 , 0 );
eixo   = Vector.XAxis();
//--------------------------------------------
Epura3D = [
           PontoPro[0][0], PontoPro[1][0], PontoPro[2][0],
           Chamadas[0][0], Chamadas[1][0], Chamadas[2][0],
           Projetad[0][1], Tracos[0][1]
          ];
PlaPH3D = Diedros[0];
PHP2D   = PlaPH3D!=null?Geometry.Rotate( PlaPH3D , orig, eixo, angulo):null;
Epu2D   = Epura3D!=null?Geometry.Rotate( Epura3D , orig, eixo, angulo):null;

[LTE, PTS, ESF, TRA, FIG, PRO, SUP, RAI, CON, INF, PHP2D, Epu2D, Epura3D, Tracos, Diedros, PontoPro, Chamadas, Projetad, Plano];
# ----------------------------------------
Resultado = Output(code_block.out23)
