# Dynamo custom node SP_Sistema_Diedrico.dyf (Dynamo 2.3.0.5885)
# category: Sistemas_Projetivos
# Cria os planos de projeção

cria_sistema_de_planos = CodeBlock()
# ---------- cria_sistema_de_planos.designscript (32 lines) ----------
d=100;

x      = [ [0,d,d,0] , [0, 0,-d,-d] , [0, 0,-d,-d] , [0,d, d, 0]];
y      = [ [0,0,d,d] , [0, d, d, 0] , [0, -d,-d,0] , [0,0,-d,-d]];
z      = [ [0,0,0,0] , [0, 0, 0, 0] , [0,  0, 0,0] , [0,0, 0, 0]];

PHp    = Point.ByCoordinates       ( x , y , z );
PVp    = Point.ByCoordinates       ( x , z , y );
PLp    = Point.ByCoordinates       ( z , x , y );
PlanH  = Surface.ByPerimeterPoints ( PHp       );
PlanV  = Surface.ByPerimeterPoints ( PVp       );

Lterra = Line.Intersect(PlanH, PlanV);

Cub1   = Cuboid.ByCorners(Point.ByCoordinates( 0 ,  0  ,  0 ),
                          Point.ByCoordinates( d , -d  ,  d ));
Cub3   = Cuboid.ByCorners(Point.ByCoordinates( 0 ,  0  ,  0 ),
                          Point.ByCoordinates( d ,  d  , -d ));
Bis13  = [ Point.ByCoordinates (0 ,  d ,  d) ,
           Point.ByCoordinates (d ,  d ,  d) ,
           Point.ByCoordinates (d , -d , -d) ,
           Point.ByCoordinates (0 , -d , -d) ];
Bis24  = [ Point.ByCoordinates (0 ,  d , -d) ,
           Point.ByCoordinates (d ,  d , -d) ,
           Point.ByCoordinates (d , -d ,  d) ,
           Point.ByCoordinates (0 , -d ,  d)   ];
Bi13   = Surface.ByPerimeterPoints  ( Bis13 );
Bi24   = Surface.ByPerimeterPoints  ( Bis24 );

Ke     = [ "Diedro"                                 , "LTerra"   , "Bisetores" , "Cuboides"];
Va     = [ [PlanH[0], PlanH[3], PlanV[0], PlanV[3]] ,  Lterra[0] , [Bi13, Bi24], [Cub1, Cub3]];
Diedro = Dictionary.ByKeysValues(Ke, Va);
# ----------------------------------------
Diedro = Output(cria_sistema_de_planos.Diedro)
